# Dynamo graph hyperbolic-paraboloid.dyn "hyperbolic-paraboloid-v1" (Dynamo 2.1.0.7500)

# group: Hyperbolic Paraboloid
origin = Point.Origin()
number = DoubleInput(0)
translate = Geometry.Translate(geometry=origin, xTranslation=number, zTranslation=number)
count_slider = IntegerSlider(5, range=2..25 step 1)
height_modifier_slider = DoubleSlider(0.5, range=0..1 step 0.1)
mul = count_slider * height_modifier_slider
translate_2 = Geometry.Translate(geometry=origin, xTranslation=number, yTranslation=count_slider, zTranslation=mul)
byStartPointEndPoint = Line.ByStartPointEndPoint(startPoint=translate, endPoint=translate_2)
translate_3 = Geometry.Translate(geometry=origin, xTranslation=count_slider, zTranslation=mul)
translate_4 = Geometry.Translate(geometry=origin, xTranslation=count_slider, yTranslation=count_slider, zTranslation=number)
byStartPointEndPoint_2 = Line.ByStartPointEndPoint(startPoint=translate_3, endPoint=translate_4)
join = List.Join(list0=byStartPointEndPoint, list1=byStartPointEndPoint_2)
byLoft = Surface.ByLoft(crossSections=join)
